# Grasshopper definition ParametricDomeModeler.gh (Grasshopper 1.0.7)
# plug-ins: tOpos

multiplication = Multiplication(B=-2)
multiplication_2 = Multiplication(B=2)

number_slider = Slider(740, range=0..1000)  # disabled
python = GhPythonScript(MVolKgM3=number_slider)  # -> KNM3; disabled
# ---------- python: Python ----------
__author__ = "adriendumont"

import rhinoscriptsyntax as rs


KNM3 = MVolKgM3 * 0.00980665
test = "cachuet"
# ---------- end python ----------
unit_z = UnitZ(Factor=expr("-1*x", python))  # disabled
load = Brep(<brep referenced from the Rhino model>)  # disabled
young_module_gpa = Slider(210, range=0..250)  # disabled
targetdensity = Slider(1, range=0..1)  # disabled
poisson = Slider(0.3, range=0..1)  # disabled
volume_load = VolumeLoad(LoadMesh=load, LoadVector=unit_z)  # disabled
number_slider_2 = Slider(1, range=0..2)  # disabled
domaine = Brep(<brep referenced from the Rhino model>)  # disabled
support = Brep([<brep referenced from the Rhino model> x8])  # disabled
number_slider_3 = Slider(5, range=0..100)  # disabled
number_slider_4 = Slider(0.6, range=0..1)  # disabled
boundary_domain = BoundaryDomain(DomainMesh=domaine, DensityValue=targetdensity, YoungModul=young_module_gpa, PoissonNumber=poisson)  # disabled
boundary_conditions = BoundaryConditions(Load=volume_load, Support=support)  # disabled
resolution = Resolution(Size=number_slider_2, sizeModeToggle=True)  # disabled
optimius_parameters = OptimiusParameters(
    OptimisationIteration=number_slider_3,
    VolumeFraction=number_slider_4,
    Penalty=Domain(2, 3),
    Change=0.005,
    SensitivityFilterRadius=Domain(1.5, 1.5),
    DensityFilterType=0,
    GrayScaleFilter=False,
    HeavisideProjection=0,
    SensitivityFilterType=1)  # disabled
model = Model(BoundaryDomain=boundary_domain, BoundaryCondition=boundary_conditions, ModelResolution=resolution, gpuModeToggle=False)  # -> Model, Performance; disabled
analyser_parameters = AnalyserParameters(Iterations=number_slider_3, Tolerance=0.001)  # disabled
boolean_toggle = BooleanToggle(False)  # disabled
button = Button()  # disabled
number_slider_5 = Slider(0.6, range=0..1)  # disabled
optimus = Optimus(
    Model=model.Model,
    AnalyserParameters=analyser_parameters,
    OptimusParameters=optimius_parameters,
    SubdivisionThreshold=0.5,
    Reset=button,
    Run=boolean_toggle,
    optimisationPreviewMode=True,
    solverType=2)  # -> Model, Compliance, Performance; disabled
voxel_mesh = VoxelMesh(Model=optimus.Model, Threshold=number_slider_5, asOneMeshMode=True, densityPreviewMode=False)  # disabled
iso_mesh = IsoMesh(Model=optimus.Model, IsoValue=number_slider_5, Deflection=0)  # disabled

expansion_d1 = Slider(486, range=10..600)
r_articulation_cm = Slider(1, range=0..2)
largeur_pj4 = Slider(10, range=0..10)
largeur_pc_cm = Slider(15, range=0..50)
epaisseur_pc_cm = Slider(5, range=0..5)
longueurpj4_cm = Slider(10, range=0..10)
marge_de_rotation = Slider(0.3, range=0..0.5)
largeur_pjx = Slider(3, range=0..20)
number_slider_6 = Slider(126, range=0..200)
choisir_l_angle_phi_voulu = ValueList({"22.5", "30.0", "45.0"}, selected="30.0")
gh_python_script = PythonScript(
    Expansion=expansion_d1,
    PhiDEG=choisir_l_angle_phi_voulu,
    l1=number_slider_6,
    lPC=largeur_pc_cm,
    ePC=epaisseur_pc_cm,
    lPJ4=largeur_pj4,
    LPJ4=longueurpj4_cm,
    MargeRota=marge_de_rotation,
    lPJX=largeur_pjx,
    RArti=r_articulation_cm)  # -> PhiDEG, PointA, PointB, PointC, PointA2, PointB2, PointC2, DistanceAA2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
# ---------- gh_python_script: Python ----------
import math
import rhinoscriptsyntax as rs

#Conversion
pi = math.pi
rad = pi/180
PhiRAD = PhiDEG * pi/180
largeurPCsur2 = lPC/2
CentreArti = lPJ4 + MargeRota + lPC/2
nPC = 180/PhiDEG*(4+180/PhiDEG)
nPJ4 = 180/PhiDEG

#Calcul du decalage Y du a CentreArti
phi = PhiDEG
if phi == 45.0 :
   a = CentreArti
   ListeAngles = (0,PhiRAD*1)
elif phi == 30.0 :
   a = math.sin(math.radians(60)) * CentreArti*2
   ListeAngles = (0,PhiRAD*1,PhiRAD*2)
elif phi == 24.0 :
   a = "a calculer"
elif phi == 22.5 :
   a = math.sin(math.radians(45))* 2 * CentreArti + CentreArti
   ListeAngles = (0,PhiRAD*1,PhiRAD*2,PhiRAD*3)
else:
   a = "Phi incorrect"

DecYDuACentreArti = a

#Rotation Verticale des PC
CentreDomeDecale = rs.CreatePoint(0,DecYDuACentreArti,CentreArti)

#Modifier la liste ci dessus en fonction de Phi

#Al- Kashi
LTotalePC = math.sqrt((l1**2) + (l1**2) - 2*l1*l1*math.cos(pi-PhiRAD))
Teta = math.asin(math.sin(PhiRAD) * Expansion / LTotalePC ) - PhiRAD
TetaDEG = math.degrees(Teta)
ExpansionMax = 1 / math.sin(PhiRAD) * LTotalePC

#Coordonnées
zPC = 0
#PointA
xA = CentreArti
yA = DecYDuACentreArti + Expansion
zA = zPC
PointA = rs.CreatePoint(xA,yA,zA)

#PointC
dxC = LTotalePC * math.sin(Teta)
xC = CentreArti + dxC
dyC = LTotalePC * math.cos(Teta)
yC = DecYDuACentreArti + Expansion  - dyC
zC = zPC
PointC = rs.CreatePoint(xC,yC,zC)

#PointB
dxB = l1 * math.sin(Teta + PhiRAD/2)
xB = CentreArti + dxB
dyB = l1 * math.cos(Teta + PhiRAD/2)
yB = DecYDuACentreArti + Expansion -dyB
zB = zPC
PointB = rs.CreatePoint(xB,yB,zB)

#PointA2
dyA2 = (math.cos(Teta + PhiRAD/2)*l1)*2
xA2 = CentreArti
yA2 = DecYDuACentreArti + Expansion - dyA2
zA2 = -ePC
PointA2 = rs.CreatePoint(xA2,yA2,zA2)

#PointB2
zB2 = zA2
PointB2 = rs.CreatePoint(xB,yB,zB2)

#PointC2
distAA2 = yA-yA2
dxC2 = math.sin(PhiRAD) * distAA2
xC2 = xC + dxC2
dyC2 = math.cos(PhiRAD) * distAA2
yC2 = yC + dyC2
zC2 = zA2
PointC2 = rs.CreatePoint(xC2,yC2,zC2)

#PJ4
ePJ4 = lPC
VectorZePJ4 = rs.CreateVector(0,0,ePJ4)
PJ4X0 = 0
PJ4X1 = lPJ4
PJ4X2 = CentreArti + lPC/2
PJ4Y0 = DecYDuACentreArti + Expansion - ePJ4/2
PJ4Z0 = 0
PJ4Z1 = PJ4Z0 + lPJ4
PJ4Z2 = PJ4Z0 + CentreArti + lPC/2

PPJ4A = rs.CreatePoint(PJ4X2,PJ4Y0,-PJ4Z1)
PPJ4B = rs.CreatePoint(PJ4X2,PJ4Y0,PJ4Z0)
PPJ4C = rs.CreatePoint(PJ4X1,PJ4Y0,PJ4Z0)
PPJ4D = rs.CreatePoint(PJ4X1,PJ4Y0,PJ4Z2)
PPJ4E = rs.CreatePoint(PJ4X0,PJ4Y0,PJ4Z2)
PPJ4F = rs.CreatePoint(PJ4X0,PJ4Y0,PJ4Z1)
PPJ4G = rs.CreatePoint(-PJ4X2,PJ4Y0,PJ4Z1)
PPJ4H = rs.CreatePoint(-PJ4X2,PJ4Y0,PJ4Z0)
PPJ4I = rs.CreatePoint(-PJ4X1,PJ4Y0,PJ4Z0)
PPJ4J = rs.CreatePoint(-PJ4X1,PJ4Y0,-PJ4Z1)
PointsPJ4 = [PPJ4A,PPJ4B,PPJ4C,PPJ4D,PPJ4E,PPJ4F,PPJ4G,PPJ4H,PPJ4I,PPJ4J]

#PerçagePJ4
PJ4AxeA = rs.CreatePoint(CentreArti,PJ4Y0+lPC/2,-PJ4Z1)

#Conversion
DistanceAA2 = yA-yA2
VectorAA2 = rs.CreateVector(0,-DistanceAA2,0)

# PJX POINTS
MargeRotaPJX = 0
ePJX = ePJ4
CentreArtiPJXA = Expansion + CentreArti 
zPJX = CentreArtiPJXA - ePJX/2
Y1PJX = MargeRotaPJX
Y2PJX = Y1PJX + lPJX
Y3PJX = - ePC - MargeRotaPJX
Y4PJX = Y3PJX - lPJX
X1PJX = DecYDuACentreArti - (lPC/2 + MargeRota)
X2PJX = DecYDuACentreArti + (lPC/2 + MargeRota)

TetaPJXRAD = math.atan(Y4PJX/X1PJX) * -1
xPJXP0transition = math.sqrt((X1PJX)**2 + (Y4PJX)**2)
PJXP0transition = rs.CreatePoint(math.sqrt((X1PJX)**2 + (Y4PJX)**2),0, 0)
yPJXP0 = math.sin(PhiRAD*2-TetaPJXRAD)*xPJXP0transition
xPJXP0 = math.cos(PhiRAD*2-TetaPJXRAD)*xPJXP0transition

PJXP0 = rs.CreatePoint( -yPJXP0,xPJXP0, zPJX)
PJXP1 = rs.CreatePoint( -Y2PJX,X1PJX, zPJX)
PJXP2 = rs.CreatePoint( -Y2PJX,X2PJX, zPJX)
PJXP3 = rs.CreatePoint( -Y1PJX,X2PJX, zPJX)
PJXP4 = rs.CreatePoint( -Y1PJX,X1PJX, zPJX)
PJXP5 = rs.CreatePoint( -Y3PJX,X1PJX, zPJX)
PJXP6 = rs.CreatePoint( -Y3PJX,X2PJX, zPJX)
PJXP7 = rs.CreatePoint( -Y4PJX,X2PJX, zPJX)
PJXP8 = rs.CreatePoint( -Y4PJX,X1PJX,zPJX)

PJXPoints = [PJXP0,PJXP1,PJXP2,PJXP3,PJXP4,PJXP5,PJXP6,PJXP7,PJXP8]
lAxePJX = rs.CreateVector(0,ePC + 2 * (MargeRota + lPJX),0)
PCentreArtiPJX = rs.CreatePoint(DecYDuACentreArti,Y4PJX, CentreArtiPJXA)
PointSommetDome = rs.CreatePoint(0,0,zPJX + ePJX)

# Couverture 
ExpansionMax = 1 / math.sin(PhiRAD) * LTotalePC
RayonCouverture = Expansion + DecYDuACentreArti + ePJ4
LSocle = (ExpansionMax + DecYDuACentreArti + ePJ4) * 1.1
OrigineSol = rs.CreatePoint( 0,0, ePJ4)

# Surface utile 
Rayon = yA2 - ePJ4
RUtile = math.sqrt(Rayon**2-1.80**2)
SUtile = math.pi*RUtile**2
# ---------- end gh_python_script ----------

# ----
# Couverture preview
cluster = Cluster()  # -> number_slider_2, point
sphere = Sphere(Base=PlaneXY(0, 0, 0), Radius=gh_python_script.RayonCouverture)
plane_surface = PlaneSurface(Plane=cluster.point, XSize=cluster.number_slider_2, YSize=cluster.number_slider_2)
split_brep = SplitBrep(Brep=sphere, Cutter=plane_surface)
hémi = ListItem(List=split_brep, Index=0, Wrap=True)
offset_surface = OffsetSurface(Surface=hémi, Distance=Slider(5, range=0..20), Retrim=True)
cap_holes = CapHoles(Brep=hémi)
cap_holes_2 = CapHoles(Brep=offset_surface)
solid_difference = SolidDifference(BrepsA=cap_holes_2, BrepsB=cap_holes)

number_slider_7 = Slider(100, range=0..100)
colour_rgb = ColourRGB(Alpha=255, Red=number_slider_7, Green=number_slider_7, Blue=number_slider_7)
create_material = CreateMaterial(Diffuse=colour_rgb, Specular=RGB(255, 255, 255), Emission=RGB(0, 0, 0), Transparency=Slider(0.9, range=0..1), Shine=0)
custom_preview = CustomPreview(Geometry=solid_difference, Material=create_material)  # disabled

plan = Orient(Geometry=plane_surface, Source=PlaneXY(0, 0, 0), Target=PlaneYZ(0, 0, 0))  # -> Geometry, Transform
hemi = SplitBrep(Brep=hémi, Cutter=plan.Geometry)
rotate = Rotate(Geometry=plan.Geometry, Angle=multiplication, Plane=PlaneXY(0, 0, 0))  # -> Geometry, Transform
list_item = ListItem(List=hemi, Index=1, Wrap=True)
split_brep_2 = SplitBrep(Brep=list_item, Cutter=rotate.Geometry)
portion = ListItem(List=split_brep_2, Index=0, Wrap=True)
mesh_surface = MeshSurface(Surface=portion, UCount=multiplication_2, VCount=multiplication_2, Overhang=False, Equalize=False)
portion_de_l_hémi = FaceBoundaries(Mesh=mesh_surface)
solid_union = SolidUnion(Breps=portion_de_l_hémi)

# ----
# Socle
number_slider_8 = Slider(20, range=0..100)
addition = Addition(A=number_slider_8, B=largeur_pj4)
center_box = CenterBox(Base=PlaneXY(0, 0, 0), X=gh_python_script.LSocle, Y=gh_python_script.LSocle, Z=number_slider_8)
unit_z_2 = UnitZ(Factor=expr("x*-1", addition))
move = Move(Geometry=center_box, Motion=unit_z_2)  # -> Geometry, Transform

polyline = PolyLine(Vertices=gh_python_script.PJXPoints, Closed=False)
circle = Circle(Plane=PlaneXZ(0, 0, 0), Radius=gh_python_script.RArti)
array = CurveArray(Geometry=polyline, Curve=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, Count=gh_python_script.nPJ4)  # -> Geometry, Transform
move_2 = Move(Geometry=circle, Motion=gh_python_script.PCentreArtiPJX)  # -> Geometry, Transform
contour = JoinCurves(Curves=array.Geometry, Preserve=False)
epjx = UnitZ(Factor=gh_python_script.ePJX)
axe_tube = Extrude(Base=move_2.Geometry, Direction=gh_python_script.lAxePJX)
extrude = Extrude(Base=contour, Direction=epjx)
curve_array = CurveArray(Geometry=axe_tube, Curve=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, Count=gh_python_script.nPJ4)  # -> Geometry, Transform
cap_holes_3 = CapHoles(Brep=extrude)
cap_holes_4 = CapHoles(Brep=curve_array.Geometry)
unit_z_3 = UnitZ(Factor=gh_python_script.DistanceAA2)
pjx_h = SolidDifference(BrepsA=cap_holes_3, BrepsB=cap_holes_4)
mep = Move(Geometry=pjx_h, Motion=expr("-x", unit_z_3))  # -> Geometry, Transform
pjx_b = Mirror(Geometry=mep.Geometry, Plane=PlaneXZ(0, 0, 0))  # -> Geometry, Transform
pjx_h_b = Brep([pjx_b.Geometry, pjx_h])

polyline_2 = PolyLine(Vertices=gh_python_script.PointsPJ4, Closed=True)
unit_y = UnitY(Factor=gh_python_script.ePJ4)
circle_cnr = CircleCNR(Center=gh_python_script.PJ4AxeA, Normal=Vector(0, 0, 1), Radius=gh_python_script.RArti)
unit_z_4 = UnitZ(Factor=gh_python_script.ePJ4)
extrude_2 = Extrude(Base=polyline_2, Direction=unit_y)
extrude_3 = Extrude(Base=circle_cnr, Direction=unit_z_4)
cap_holes_5 = CapHoles(Brep=extrude_3)
curve_array_2 = CurveArray(Geometry=cap_holes_5, Curve=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, Count=4)  # -> Geometry, Transform
pj41 = SolidDifference(BrepsA=extrude_2, BrepsB=curve_array_2.Geometry)
cap_holes_6 = CapHoles(Brep=pj41)
mirror = Mirror(Geometry=cap_holes_6, Plane=PlaneYZ(0, 0, 0))  # -> Geometry, Transform
pj42 = Move(Geometry=mirror.Geometry, Motion=gh_python_script.VectorAA2)  # -> Geometry, Transform
pj4s = Brep([cap_holes_6, pj42.Geometry])

cylinder = Cylinder(Base=PlaneXY(0, 0, 0), Radius=gh_python_script.RUtile, Length=180)

création_pc1 = CréationPC(
    points_abc=[gh_python_script.PointA, gh_python_script.PointB, gh_python_script.PointC],
    radius=gh_python_script.lPC,
    factor=gh_python_script.ePC,
    distance=gh_python_script.largeurPCsur2,
    radius_2=gh_python_script.RArti,
    largeurpcsur2=gh_python_script.largeurPCsur2)  # -> result, axes
création_pc = CréationPC(
    points_abc=[gh_python_script.PointA2, gh_python_script.PointB2, gh_python_script.PointC2],
    radius=gh_python_script.lPC,
    factor=gh_python_script.ePC,
    distance=gh_python_script.largeurPCsur2,
    radius_2=gh_python_script.RArti,
    largeurpcsur2=gh_python_script.largeurPCsur2)  # -> result, axes

choisir_le_matériau = ValueList({"Bois lamellé collé": "GL22", "Bois résineux courant": "C18"}, selected="Bois lamellé collé")
volume = Volume(Geometry=création_pc.result)  # -> Volume, Centroid
volume_2 = Volume(Geometry=cap_holes_6)  # -> Volume, Centroid
volume_3 = Volume(Geometry=mep.Geometry)  # -> Volume, Centroid
ghpython_script = GhPythonScript(
    Phi=choisir_l_angle_phi_voulu,
    lPC=largeur_pc_cm,
    ePC=epaisseur_pc_cm,
    VPCcm3=volume.Volume,
    VPJ4cm3=volume_2.Volume,
    VPJXcm3=volume_3.Volume,
    Materiau=choisir_le_matériau)  # -> nPC, CMAXenNcm2, CREELLEenNcm2, PoidsPCkg, QPCkg, ePCmini, PoidsTotal, ETAT
# ---------- ghpython_script: Python ----------
__author__ = "imacadriendumont"

import rhinoscriptsyntax as rs

#Unites / Transposition
VPCm3 = VPCcm3/1000000
VPJ4m3 = VPJ4cm3/1000000
VPJXm3 = VPJXcm3/1000000


""" Lorsque Phi = 22.5 """
NombrePCCharge = 6
nQuartier = 180/Phi
nPCHorizontales = 4 * nQuartier
nPCVerticales = 8 * nQuartier
nPC = nPCHorizontales + nPCVerticales
nPJ4 = 360 / Phi
"""" Fin Phi dépendant """

if Materiau == "C18" :
    MVolumique = 320
    ContrainteCalculNmm2 = 9.7
if Materiau == "GL22" :
    MVolumique = 330
    ContrainteCalculNmm2 = 12.3
CMAXenNcm2 = ContrainteCalculNmm2 * 100

# CALCUL POIDS DES PIECES
PoidsPCkg = VPCm3 * MVolumique
PoidsPJXkg = VPJXm3 * MVolumique
PoidsPJ4kg = VPJ4m3 * MVolumique
PoidsCouverture = 200

#CHARGE sur 1 PC 
QPCkg = PoidsPCkg * NombrePCCharge + 1/8 * (2*PoidsPJXkg + PoidsCouverture)
QPCNewton = QPCkg * 9.807

# Calcul Epaisseur PC selon contrainte et charge
ePCmini = (QPCNewton / CMAXenNcm2) / lPC
Sectioncm2 = ePC * lPC
CREELLEenNcm2 = QPCNewton / Sectioncm2
if CREELLEenNcm2 > CMAXenNcm2 :
    ETAT = " STRUCTURE SURCHARGEE "
else : ETAT = " STRUCTURE OK"



#POIDS TOTAL
PoidsTotal = nPC * PoidsPCkg + 2 * PoidsPJXkg + nPJ4 * PoidsPJ4kg
# ---------- end ghpython_script ----------
panel = Panel(ghpython_script.CMAXenNcm2)
panel_2 = Panel(ghpython_script.PoidsPCkg)
panel_3 = Panel(ghpython_script.QPCkg)
panel_4 = Panel(ghpython_script.ePCmini)
panel_5 = Panel(ghpython_script.PoidsTotal)
panel_6 = Panel(ghpython_script.ETAT)
panel_7 = Panel(ghpython_script.CREELLEenNcm2)

pairepc1 = Brep([création_pc1.result, création_pc.result])
mirror_2 = Mirror(Geometry=pairepc1, Plane=PlaneYZ(0, 0, 0))  # -> Geometry, Transform
pairedepc2 = Mirror(Geometry=mirror_2.Geometry, Plane=PlaneXY(0, 0, 0))  # -> Geometry, Transform
module_pour_cercle_de_base = Brep([pairepc1, pj4s, pairedepc2.Geometry])
cerclesverticaux = AXESVerticaux(
    geometry=pairedepc2.Geometry,
    angle=gh_python_script.ListeAngles,
    center=gh_python_script.CentreDomeDecale,
    count=gh_python_script.PhiDEG)
cerclehorizontale = CurveArray(Geometry=module_pour_cercle_de_base, Curve=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, Count=gh_python_script.nPJ4)  # -> Geometry, Transform
pc_verticales = Brep(flatten(cerclesverticaux))

axes = Brep([création_pc.axes, création_pc1.axes])
mirror_3 = Mirror(Geometry=axes, Plane=PlaneYZ(0, 0, 0))  # -> Geometry, Transform
paired_axe = Mirror(Geometry=mirror_3.Geometry, Plane=PlaneXY(0, 0, 0))  # -> Geometry, Transform
module_pour_cercle_de_base_2 = Brep([axes, paired_axe.Geometry])
axesverticaux = AXESVerticaux(
    geometry=paired_axe.Geometry,
    angle=gh_python_script.ListeAngles,
    center=gh_python_script.CentreDomeDecale,
    count=gh_python_script.PhiDEG)
cerclehorizontale_2 = CurveArray(Geometry=module_pour_cercle_de_base_2, Curve=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, Count=gh_python_script.nPJ4)  # -> Geometry, Transform
axes_verticales = Brep(flatten(axesverticaux))

complete = Brep([pjx_h_b, pc_verticales, cerclehorizontale.Geometry])

# ==== cluster AXESVerticaux
geometry = ClusterInput()
pairedepcverticale = Rotate(Geometry=geometry, Angle=-1.570796327, Plane=PlaneXZ(0, 0, 0))  # -> Geometry, Transform
angle = ClusterInput()
center = ClusterInput()
rotate_3d = Rotate3D(Geometry=graft(pairedepcverticale.Geometry), Angle=angle, Center=center, Axis=Vector(1, 0, 0))  # -> Geometry, Transform
count = ClusterInput()
polar_array = PolarArray(Geometry=rotate_3d.Geometry, Plane=PlaneXY(0, 0, 0), Count=expr("180/x", count), Angle=6.283185307)  # -> Geometry, Transform
geometry_2 = ClusterOutput(polar_array.Geometry)

# ==== cluster CréationPC
points_abc = ClusterInput()
distance = ClusterInput()
largeurpcsur2 = ClusterInput()
polyline = PolyLine(Vertices=points_abc, Closed=False)
subtraction = Subtraction(A=0, B=largeurpcsur2)
offset = Offset(Curve=polyline, Distance=[subtraction, distance], Plane=PlaneXY(0, 0, 0), Corners=1)
extend_curve = ExtendCurve(Curve=polyline, Type=0, Start=largeurpcsur2, End=largeurpcsur2)
end_points = EndPoints(Curve=offset)  # -> simplify(Start), simplify(End)
end_points_2 = EndPoints(Curve=extend_curve)  # -> Start, End
point = Point(simplify(graft([end_points_2.Start, end_points_2.End])))
point_2 = Point([end_points.Start, end_points.End])
flip_matrix = FlipMatrix(Data=point_2)
radius = ClusterInput()
fillet = Fillet(Curve=offset, Radius=radius)
list_item = ListItem(List=flip_matrix, Index=1, Wrap=True)
list_item_2 = ListItem(List=flip_matrix, Index=0, Wrap=True)
arc_3pt = Arc3Pt(PointA=list_item_2, PointB=point, PointC=list_item)  # -> Arc, Plane, Radius
factor = ClusterInput()
radius_2 = ClusterInput()
join_curves = JoinCurves(Curves=flatten([fillet, arc_3pt.Arc]), Preserve=False)
unit_z = UnitZ(Factor=factor)
circle = Circle(Plane=points_abc, Radius=radius_2)
extrude = Extrude(Base=join_curves, Direction=unit_z)
extrude_2 = Extrude(Base=circle, Direction=unit_z)
cap_holes = CapHoles(Brep=extrude)
cap_holes_2 = CapHoles(Brep=extrude_2)
solid_difference = SolidDifference(BrepsA=cap_holes, BrepsB=cap_holes_2)
axes = ClusterOutput(cap_holes_2)
result = ClusterOutput(solid_difference)

# ==== cluster Cluster
number_slider = Slider(1366, range=0..2000)
division = Division(A=number_slider, B=2)
number_slider_2 = ClusterOutput(number_slider)
multiplication = Multiplication(A=division, B=-1)
construct_point = ConstructPoint(XCoordinate=multiplication, YCoordinate=multiplication, ZCoordinate=0)
point = ClusterOutput(construct_point)
